# Grasshopper definition CaseStudy1.gh (Grasshopper 1.0.7)
# plug-ins: VegardOgOlav

# ----
# Nr. of elements
number_slider = Slider(1, range=0..5)
panel = Panel("""1
2
4
8
16""")

# ----
# Global box
number_slider_2 = Slider(1000, range=0..10000)
rectangle = Rectangle(Plane=PlaneXY(0, 0, 0), XSize=number_slider_2, YSize=number_slider_2, Radius=0)  # -> Rectangle, Length
box_rectangle = BoxRectangle(Rectangle=rectangle.Rectangle, Height=number_slider_2)
box_corners = BoxCorners(Box=box_rectangle)  # -> CornerA, CornerB, CornerC, CornerD, CornerE, CornerF, CornerG, CornerH
merge = Merge(
    Data1=box_corners.CornerA,
    Data2=box_corners.CornerB,
    Data3=box_corners.CornerC,
    Data4=box_corners.CornerD,
    Data5=box_corners.CornerE,
    Data6=box_corners.CornerF,
    Data7=box_corners.CornerG,
    Data8=box_corners.CornerH)

number_slider_3 = Slider(1, range=0..1)

# ----
# Make mesh
list_item = ListItem(List=panel, Index=number_slider, Wrap=True)
division = Division(A="1000", B=list_item)
rectangle_2 = Rectangle(Plane=PlaneXY(0, 0, 0), XSize=division, YSize=division, Radius=0)  # -> Rectangle, Length
series = Series(Start=Slider(0, range=0..10), Step=Slider(1, range=0..10), Count=list_item)
multiplication = Multiplication(A=series, B=division)
unit_x = UnitX(Factor=multiplication)
box_rectangle_2 = BoxRectangle(Rectangle=rectangle_2.Rectangle, Height=division)
unit_y = UnitY(Factor=multiplication)
unit_z = UnitZ(Factor=multiplication)
move = Move(Geometry=box_rectangle_2, Motion=unit_x)  # -> graft(Geometry), Transform
move_2 = Move(Geometry=move.Geometry, Motion=unit_y)  # -> graft(Geometry), Transform
move_3 = Move(Geometry=move_2.Geometry, Motion=unit_z)  # -> flatten(Geometry), Transform
mesh_box = MeshBox(Base=move_3.Geometry, XCount=number_slider_3, YCount=number_slider_3, ZCount=number_slider_3)

# ----
# Support
deconstruct_mesh = DeconstructMesh(Mesh=mesh_box)  # -> flatten(Vertices), Faces, Colours, Normals
cull_duplicates = CullDuplicates(Points=deconstruct_mesh.Vertices, Tolerance=0.1, CullMode=3)  # -> Points, Indices, Valence
c_script = CSharpScript(x=cull_duplicates.Points)  # -> supPts; inputs x: list of Point3d
# ---------- c_script: C# ----------
    List<Point3d> sups = new List<Point3d>();

    for(int i = 0; i < x.Count;i++)
    {
      if(x[i].Y < 10)
        sups.Add(x[i]);
    }
    supPts = sups;
# ---------- end c_script ----------
clean_tree = CleanTree(RemoveNulls=True, RemoveInvalid=True, RemoveEmpty=False, Tree=c_script)

# ----
# Load
number_slider_4 = Slider(10000, range=0..10000)
negative = Negative(Value=number_slider_4)
panel_2 = Panel("""6
7""")
unit_z_2 = UnitZ(Factor=negative)
list_item_2 = ListItem(List=merge, Index=panel_2, Wrap=True)

# ----
# PreFerret
support = Support(Point=clean_tree)
load = Load(Point=list_item_2, Direction=unit_z_2)
element = Element(Mesh=mesh_box)
assembly = Assembly(Element=element, Support=support, Load=load)
solver = Solver(Assembly=assembly)  # -> Result, Result_2

# ----
# Cordinates of nodes r
panel_3 = Panel(solver.Result)

# ----
# Max displacement
sort_list = SortList(Keys=solver.Result_2)  # -> Keys, ValuesValuesA
list_item_3 = ListItem(List=sort_list.Keys, Index=0, Wrap=True)
panel_4 = Panel(list_item_3)

# ----
# Find the correct node we want to se the displacements of:
number_slider_5 = Slider(8, range=0..3000)
point = Point(solver.Result)
multiplication_2 = Multiplication(A=number_slider_5, B="3")
list_item_4 = ListItem(List=solver.Result, Index=number_slider_5, Wrap=True)
point_list = PointList(Points=point, Size=Slider(63, range=0..1000))
series_2 = Series(Start=multiplication_2, Step=1, Count="3")
list_item_5 = ListItem(List=solver.Result_2, Index=series_2, Wrap=True)
panel_5 = Panel(list_item_5)

# ----
# Displacement(xi,yi,zi):
panel_6 = Panel(solver.Result_2)
