# Grasshopper definition CaseStudy2.gh (Grasshopper 1.0.7)
# plug-ins: TetgenGH, SolidFEM, IguanaMesh, GH_to_FEniCSx

# ----
# Volume mesh settings
number_slider = Slider(20, range=0..100)  # disabled
number_slider_2 = Slider(1, range=0..1000)  # disabled
number_slider_3 = Slider(100, range=0..1000)  # disabled
ilineartetraprism = ILinearTetraPrism(
    Size=number_slider,
    MinimumSize=number_slider_2,
    MaximunSize=number_slider_3,
    CurvatureAdapt=True,
    MinimumElements=6,
    Optimization=0,
    QualityType=2,
    QualityThreshold=0.3,
    Massive_Refinement=False)  # disabled

# ----
# Tetrino meshing
number_slider_4 = Slider(4, range=1..20)

# ----
# Geometry
panel = Panel("1000")  # disabled
panel_2 = Panel("200")  # disabled
rectangle = Rectangle(Plane=PlaneXY(0, 0, 0), XSize=panel, YSize=panel_2, Radius=0)  # -> Rectangle, Length; disabled
panel_3 = Panel("400")  # disabled
box_rectangle = BoxRectangle(Rectangle=rectangle.Rectangle, Height=panel_3)  # disabled

# ----
# Element
panel_4 = Panel("1000")  # disabled
panel_5 = Panel("200")  # disabled
rectangle_2 = Rectangle(Plane=PlaneXY(0, 0, 0), XSize=panel_4, YSize=panel_5, Radius=0)  # -> Rectangle, Length; disabled
panel_6 = Panel("400")  # disabled
box_rectangle_2 = BoxRectangle(Rectangle=rectangle_2.Rectangle, Height=panel_6)  # disabled
brep = Brep(box_rectangle_2)  # disabled

# ----
# Iguana meshing
# Meshing
# By default, internal elements of a volume mesh are not displayed.
# To visualize them, use components from the "Utils" category.
ifillbrep = IFillBrep(Brep=box_rectangle, ISettings=ilineartetraprism)  # -> IMesh, Entities, Info; disabled
ideconstructmesh = IDeconstructMesh(IMesh=ifillbrep.IMesh)  # -> IVertices, VertexKeys, IElements, IKeysE, SiblingHalfFacets, VertexToHalfFacet; disabled
panel_7 = Panel(ifillbrep.Info)  # disabled
ifindelement = IFindElement(IMesh=ifillbrep.IMesh, Element=ideconstructmesh.IKeysE)  # -> IElement, Geometry; disabled
simple_mesh = SimpleMesh(Brep=ifindelement.Geometry)  # disabled
tetrahedralize = Tetrahedralize(Mesh=simple_mesh, Flags=1, MinRatio=2)  # -> flatten(Mesh), Indices, Points; disabled

# ----
# Meshing
number_slider_5 = Slider(500, range=0..10000)  # disabled
panel_8 = Panel("460")  # disabled
quad_remesh_settings = QuadRemeshSettings(TargetCount=panel_8, AdaptiveSize=0, AdaptiveCount=False, HardEdges=True, SeamEdges=0, Symmetry=0, GuideCurves=0)  # disabled
mesh_brep = MeshBrep(
    Brep=brep,
    Settings={GridMaxCount=0, GridMinCount=16, JaggedSeams=False, MaxEdgeLength=0, MinEdgeLength=0.0001, MinTolerance=0, Refine=True, RefineAngle=0, RelativeTolerance=0.65, SimplePlanes=True, Tolerance=0})  # disabled
number_slider_6 = Slider(0, range=0..500)  # disabled
number_slider_7 = Slider(10, range=0..100)  # disabled
quad_remesh = QuadRemesh(Mesh=mesh_brep, Settings=quad_remesh_settings)  # disabled
tetrahedralize_2 = Tetrahedralize(Mesh=quad_remesh, Flags=number_slider_6, MinRatio=number_slider_7)  # -> Mesh, Indices, Points; disabled
mesh = Mesh(tetrahedralize_2.Mesh)  # disabled

deformation = Slider(1, range=1..6)
mises_stress = Slider(2, range=1..6)

# ----
# Rotate between x and y
number_slider_8 = Slider(90, range=0..100)
radians = Radians(Degrees=number_slider_8)

# ----
# Own-developed meshing algorithm + Tetrino
make_perfect_mesh = MakePerfectMesh(
    lenght="2000",
    nr_el_lenght=Slider(11, range=1..40),
    width="400",
    nr_el_width=Slider(2, range=1..20),
    height="800",
    nr_el_height=number_slider_4)

rotate_3d = Rotate3D(Geometry=make_perfect_mesh, Angle=radians, Center=Point(0, 0, 0), Axis=Vector(0, 0, 1))  # -> Geometry, Transform

brep_2 = Brep(rotate_3d.Geometry)

simple_mesh_2 = SimpleMesh(Brep=brep_2)
tetrahedralize_3 = Tetrahedralize(Mesh=simple_mesh_2, Flags="0", MinRatio=2)  # -> flatten(Mesh), Indices, Points

# ----
# Make Abaqus-mesh hexahedron
cleanmesh = CleanMesh(Mesh=simple_mesh_2)
list_length = ListLength(List=cleanmesh)  # disabled
nr_elements = Panel(list_length)  # disabled

# ----
# Mesh
mesh_2 = Mesh(tetrahedralize_3.Mesh)
mesh_edges = MeshEdges(Mesh=mesh_2)  # -> NakedEdges, InteriorEdges, NonManifoldEdges

# ----
# Support
deconstruct_mesh = DeconstructMesh(Mesh=mesh_2)  # -> flatten(Vertices), Faces, Colours, Normals
support_at_x_0 = CSharpScript(Point=deconstruct_mesh.Vertices)  # -> Support; inputs Point: list of Point3d
# ---------- support_at_x_0: C# ----------
    List < Point3d > Sups = new List<Point3d>();

    for(int i = 0; i < Point.Count; i++)
    {
      if (Point[i].Y == 0)
      {
        Sups.Add(Point[i]);
      }
    }
    Support = Sups;
# ---------- end support_at_x_0 ----------
support_at_y_0 = CSharpScript(Point=deconstruct_mesh.Vertices)  # -> Support; inputs Point: list of Point3d
# ---------- support_at_y_0: C# ----------
    List < Point3d > Sups = new List<Point3d>();

    for(int i = 0; i < Point.Count; i++)
    {
      if (Point[i].X == 0)
      {
        Sups.Add(Point[i]);
      }
    }
    Support = Sups;
# ---------- end support_at_y_0 ----------
support_points = Point(support_at_x_0)
fem_boundaryonpoints = FEM_BoundaryOnPoints(Mesh=mesh_2, SupportPoints=support_points, Ty_2=True, Ty_3=True, Ty_4=True)

sunion = SolidUnion(Breps=brep_2)
# Ferret
box_corners = BoxCorners(Box=sunion)  # -> CornerA, CornerB, CornerC, CornerD, CornerE, CornerF, CornerG, CornerH

# ----
# Load
panel_9 = Panel("-10000")
Z = UnitZ(Factor=panel_9)
division = Division(A=Z, B=50)
load_points_for_beam_along_x_axis = Point([box_corners.CornerG, box_corners.CornerF])
load_points_for_beam_along_y_axis = Point([box_corners.CornerH, box_corners.CornerG])
unit_z = UnitZ(Factor=panel_9)
negative = Negative(Value=division)

load_pts = Point(load_points_for_beam_along_y_axis)

move = Move(Geometry=load_pts, Motion=negative)  # -> Geometry, Transform
fem_load = FEMLoad(MeshList=mesh_2, Type="1", Position=load_pts, Vector=unit_z)  # -> Load, Points, ResultantLoadAndArea
vector_display = VectorDisplay(Anchor=move.Geometry, Vector=division)

# ----
# Material
number_slider_9 = Slider(30, range=0..100)
fem_material = FEMMaterial(YoungModulus=210000, PossionRatio=0.3, YieldingStress=355, MaterialWeight=7850)  # disabled

# ----
# Transforming v_12 wrt rotation
# v12->v21
number_slider_10 = Slider(0.5, range=0..1)
multiplication = Multiplication(A=number_slider_10, B="800")
division_2 = Division(A=multiplication, B="10000")

fem_material_orto = FEMMaterialOrto(
    YoungModulusE1="800",
    YoungModulusE2="10000",
    YoungModulusE3=400,
    ShearModulusG1=600,
    ShearModulusG2=600,
    ShearModulusG3=30,
    PossionRatioV12=division_2,
    PossionRatioV13=0.6,
    PossionRatioV23=0.6,
    YieldingStress=number_slider_9,
    MaterialWeight=Slider(0, range=0..1000))

# ----
# Solver
new_fem_solver = NEWFEMSolver(Mesh=mesh_2, ElementOrder="1", Loads=fem_load.Load, BoundaryConditions=fem_boundaryonpoints, Material=fem_material_orto)  # -> U1, U2, U3, ElementStress, NodeStress, Diagonstics, FE_Mesh, Points, GlobalK

# ----
# Result preview
number_slider_11 = Slider(100, range=0..100)
panel_10 = Panel("39.64")
meshpreview = MeshPreview(AnalysedFEMesh=new_fem_solver.FE_Mesh, Type=deformation, DisplacementScaling=number_slider_11)  # -> DeformedModel, DeformedMesh
mesh_edges_2 = MeshEdges(Mesh=meshpreview.DeformedMesh)  # -> NakedEdges, InteriorEdges, NonManifoldEdges

# ----
# Find the correct node we want to see the result of:
node_number = Slider(200, range=0..10000)
number_size = Slider(5, range=0..100)
list_item = ListItem(List=new_fem_solver.U3, Index=node_number, Wrap=True)
list_item_2 = ListItem(List=new_fem_solver.Points, Index=node_number, Wrap=True)
point_list = PointList(Points=new_fem_solver.Points, Size=number_size)
result_value = Panel(list_item)

# ----
# Results sorted in ascending order
sort_list = SortList(Keys=new_fem_solver.U3)  # -> Keys, ValuesValuesA
panel_11 = Panel(sort_list.Keys)

# ==== cluster MakePerfectMesh
nr_el_width = ClusterInput()
nr_el_height = ClusterInput()
width = ClusterInput()
height = ClusterInput()
nr_el_lenght = ClusterInput()
lenght = ClusterInput()
nr_el_width_2 = Number(nr_el_width)
nr_el_height_2 = Number(nr_el_height)
width_2 = Number(width)
height_2 = Number(height)
nr_el_lenght_2 = Number(nr_el_lenght)
lenght_2 = Number(lenght)
series = Series(Start="0", Step="1", Count=nr_el_lenght_2)
series_2 = Series(Start="0", Step="1", Count=nr_el_height_2)
division = Division(A=lenght_2, B=nr_el_lenght_2)
series_3 = Series(Start="0", Step="1", Count=nr_el_width_2)
division_2 = Division(A=width_2, B=nr_el_width_2)
division_3 = Division(A=height_2, B=nr_el_height_2)
# Making elements
rectangle = Rectangle(Plane=PlaneXY(0, 0, 0), XSize=division, YSize=division_2, Radius=0)  # -> Rectangle, Length
box_rectangle = BoxRectangle(Rectangle=rectangle.Rectangle, Height=division_3)
multiplication = Multiplication(A=series, B=division)
multiplication_2 = Multiplication(A=series_3, B=division_2)
multiplication_3 = Multiplication(A=series_2, B=division_3)
unit_x = UnitX(Factor=multiplication)
unit_y = UnitY(Factor=multiplication_2)
unit_z = UnitZ(Factor=multiplication_3)
move = Move(Geometry=box_rectangle, Motion=unit_x)  # -> graft(Geometry), Transform
move_2 = Move(Geometry=move.Geometry, Motion=unit_y)  # -> graft(Geometry), Transform
move_3 = Move(Geometry=move_2.Geometry, Motion=unit_z)  # -> flatten(Geometry), Transform
geometry = ClusterOutput(move_3.Geometry)
hexahedron_elements = Brep(move_3.Geometry)
