# Grasshopper definition CaseStudy3.gh (Grasshopper 1.0.7)
# plug-ins: IguanaMesh, TetgenGH, SolidFEM

# ----
# Geometry
panel = Panel("1000")
rectangle = Rectangle(Plane=PlaneXY(0, 0, 0), XSize=panel, YSize="200", Radius=0)  # -> Rectangle, Length
box_rectangle = BoxRectangle(Rectangle=rectangle.Rectangle, Height="400")

# ----
# Creating dowel
edges = BrepEdges(Brep=box_rectangle)  # -> Naked, Interior, NonManifold
Y = UnitY(Factor=1)
item = ListItem(List=edges.Interior, Index="10", Wrap=True)
X = UnitX(Factor="-250")
midpt = CurveMiddle(Curve=item)
move = Move(Geometry=midpt, Motion=X)  # -> Geometry, Transform
circle = CircleCNR(Center=move.Geometry, Normal=Y, Radius="50")
Y_2 = UnitY(Factor="100")
Y_3 = UnitY(Factor=1)
move_2 = Move(Geometry=circle, Motion=Y_2)  # -> Geometry, Transform
Y_4 = UnitY(Factor="-400")
extr = Extrude(Base=move_2.Geometry, Direction=Y_4)
cap = CapHoles(Brep=extr)
rot3d = Rotate3D(Geometry=cap, Angle=degrees(Slider(90, range=0..100)), Center=move.Geometry, Axis=Y_3)  # -> Geometry, Transform
debrep = DeconstructBrep(Brep=rot3d.Geometry)  # -> Faces, Edges, Vertices
pt = Point(flatten(debrep.Vertices))
brep = Brep(rot3d.Geometry)

# ----
# Square dowel
panel_2 = Panel("-50 to 50")
xz = XZPlane(Origin=move_2.Geometry)
rectangle_2 = Rectangle(Plane=xz, XSize=panel_2, YSize=panel_2, Radius=0)  # -> Rectangle, Length
Y_5 = UnitY(Factor="-400")
extr_2 = Extrude(Base=rectangle_2.Rectangle, Direction=Y_5)
cap_2 = CapHoles(Brep=extr_2)
debrep_2 = DeconstructBrep(Brep=cap_2)  # -> Faces, Edges, Vertices
panel_3 = Panel("""2
3""")
item_2 = ListItem(List=debrep_2.Edges, Index=panel_3, Wrap=True)
end = EndPoints(Curve=item_2)  # -> Start, End
pt_2 = Point(flatten([end.Start, end.End]))
brep_2 = Brep(cap_2)

# ----
# Chosen geometry
load_points = Point(pt)
dowel_brep = Brep(brep)

# ----
# Steel+Timber
# timber
# steel
brep_3 = Brep(box_rectangle)
brep_4 = Brep(dowel_brep)
trim_solid = TrimSolid(Shape=brep_3, Cutters=brep_4)

# ----
# Meshing and organizing the two parts
number_slider = Slider(10, range=0..100)
solid_difference = SolidDifference(BrepsA=trim_solid, BrepsB=brep_4)
trim_tree = TrimTree(Tree=solid_difference, Depth=1)
ilineartetraprism = ILinearTetraPrism(
    Size=number_slider,
    MinimumSize=Slider(1, range=0..1000),
    MaximunSize=Slider(40, range=0..1000),
    CurvatureAdapt=True,
    MinimumElements=6,
    Optimization=0,
    QualityType=2,
    QualityThreshold=0.3,
    Massive_Refinement=False)
solid_union = SolidUnion(Breps=[brep_4, trim_tree])
ifillbrep = IFillBrep(Brep=solid_union, ISettings=ilineartetraprism)  # -> graft(IMesh), Entities, Info
ideconstructmesh = IDeconstructMesh(IMesh=ifillbrep.IMesh)  # -> IVertices, VertexKeys, IElements, IKeysE, SiblingHalfFacets, VertexToHalfFacet
ifindelement = IFindElement(IMesh=ifillbrep.IMesh, Element=ideconstructmesh.IKeysE)  # -> IElement, Geometry
simple_mesh = SimpleMesh(Brep=ifindelement.Geometry)
tetrahedralize = Tetrahedralize(Mesh=simple_mesh, Flags=1, MinRatio=2)  # -> flatten(Mesh), Indices, Points
deconstruct_mesh = DeconstructMesh(Mesh=tetrahedralize.Mesh)  # -> Vertices, Faces, Colours, Normals
point_in_breps = PointInBreps(Brep=brep_4, Point=deconstruct_mesh.Vertices, Strict=False)  # -> Inside, Index
c_script = CSharpScript(Inside=point_in_breps.Inside, Rule="1")  # -> A; inputs Inside: tree of Boolean, Rule: Int32
# ---------- c_script: C# ----------
    List<bool> inside = new List<bool>();
    DataTree<bool> x = Inside;
    int y = Rule;

    for(int i = 0;i < x.BranchCount;i++)
    {
      int counter = 0;
      for(int j = 0;j < x.Branch(i).Count;j++)
      {
        if(x.Branch(i)[j] == true)
        {
          counter++;
        }
      }

      if(counter > y)
      {
        inside.Add(true);
      }
      else
      {
        inside.Add(false);
      }

    }
    A = inside;
# ---------- end c_script ----------
dispatch = Dispatch(List=tetrahedralize.Mesh, DispatchPattern=c_script)  # -> ListA, ListB
steel_mesh = Mesh(dispatch.ListA)
timber_mesh = Mesh(dispatch.ListB)
entwine = Entwine(Branch0X=steel_mesh, Branch1X=timber_mesh, FlattenInputs=False)

# ----
# Meshing with Tetrino
number_slider_2 = Slider(50, range=0..100)
brep_5 = Brep(solid_union)
quad_remesh_settings = QuadRemeshSettings(
    TargetCount="1000",
    AdaptiveSize=number_slider_2,
    AdaptiveCount=True,
    HardEdges=True,
    SeamEdges=1,
    Symmetry=1,
    GuideCurves=1)
mesh_brep = MeshBrep(
    Brep=brep_5,
    Settings={GridMaxCount=0, GridMinCount=16, JaggedSeams=False, MaxEdgeLength=0, MinEdgeLength=0.0001, MinTolerance=0, Refine=True, RefineAngle=0, RelativeTolerance=0.65, SimplePlanes=True, Tolerance=0})
quad_remesh = QuadRemesh(Mesh=mesh_brep, Settings=quad_remesh_settings)
tetrahedralize_2 = Tetrahedralize(Mesh=quad_remesh, Flags=Slider(0, range=0..500), MinRatio=Slider(10, range=0..100))  # -> Mesh, Indices, Points
mesh = Mesh(tetrahedralize_2.Mesh)
deconstruct_mesh_2 = DeconstructMesh(Mesh=mesh)  # -> Vertices, Faces, Colours, Normals
point_in_breps_2 = PointInBreps(Brep=brep_4, Point=deconstruct_mesh_2.Vertices, Strict=False)  # -> Inside, Index
c_script_2 = CSharpScript(Inside=point_in_breps_2.Inside, Rule="3")  # -> A; inputs Inside: tree of Boolean, Rule: Int32; same code as c_script
dispatch_2 = Dispatch(List=mesh, DispatchPattern=c_script_2)  # -> ListA, ListB
steel_mesh_2 = Mesh(dispatch_2.ListA)
timber_mesh_2 = Mesh(dispatch_2.ListB)
entwine_2 = Entwine(Branch0X=steel_mesh_2, Branch1X=timber_mesh_2, FlattenInputs=False)

# ----
# Material
number_slider_3 = Slider(0, range=0..100)
number_slider_4 = Slider(300, range=0..1000)
fem_material_orto = FEMMaterialOrto(
    YoungModulusE1=10000,
    YoungModulusE2=800,
    YoungModulusE3=400,
    ShearModulusG1=600,
    ShearModulusG2=600,
    ShearModulusG3=30,
    PossionRatioV12=0.5,
    PossionRatioV13=0.6,
    PossionRatioV23=0.6,
    YieldingStress=Slider(50, range=0..100),
    MaterialWeight=number_slider_3)
fem_material = FEMMaterial(YoungModulus=210000, PossionRatio=0.3, YieldingStress=355, MaterialWeight=number_slider_3)
merge = Merge(Data1=fem_material, Data2=fem_material_orto)  # -> simplify(graft(Result))

# ----
# Organizing the parts
mesh_2 = Mesh(entwine)
mesh_edges = MeshEdges(Mesh=mesh_2)  # -> NakedEdges, InteriorEdges, NonManifoldEdges
fem_part = FEMPart(MeshList=mesh_2, Material=merge)  # -> flatten(Meshes), flatten(Materials)

# ----
# Load
panel_4 = Panel("5000")
unit_x = UnitX(Factor=panel_4)
division = Division(A=unit_x, B=20)
demesh = DeconstructMesh(Mesh=mesh_2)  # -> Vertices, Faces, Colours, Normals
cp = ClosestPoint(Point=graft(load_points), Cloud=flatten(demesh.Vertices))  # -> flatten(ClosestPoint), CPIndex, Distance
negative = Negative(Value=division)
load_points_2 = Point(cp.ClosestPoint)
move_3 = Move(Geometry=load_points_2, Motion=negative)  # -> Geometry, Transform
fem_load = FEMLoad(MeshList=fem_part.Meshes, Type="1", Position=load_points_2, Vector=unit_x)  # -> flatten(Load), Points, ResultantLoadAndArea
vector_display = VectorDisplay(Anchor=move_3.Geometry, Vector=division)

# ----
# Support
deconstruct_mesh_3 = DeconstructMesh(Mesh=fem_part.Meshes)  # -> flatten(Vertices), Faces, Colours, Normals
support_points_at_x_0 = CSharpScript(Point=deconstruct_mesh_3.Vertices)  # -> Support; inputs Point: list of Point3d
# ---------- support_points_at_x_0: C# ----------
    List < Point3d > Sups = new List<Point3d>();

    for(int i = 0; i < Point.Count; i++)
    {
      if (Point[i].X <= 0.0001)
      {
        Sups.Add(Point[i]);
      }
    }
    Support = Sups;
# ---------- end support_points_at_x_0 ----------
support_points = CullDuplicates(Points=support_points_at_x_0, Tolerance=0.1, CullMode=3)  # -> Points, Indices, Valence
fem_boundaryonpoints = FEM_BoundaryOnPoints(Mesh=fem_part.Meshes, SupportPoints=support_points.Points, Ty_2=True, Ty_3=True, Ty_4=True)  # -> flatten(Supports)

# ----
# Solver
part_fem_solver = PartFEMSolver(
    Mesh=fem_part.Meshes,
    ElementOrder=1,
    Loads=fem_load.Load,
    BoundaryConditions=fem_boundaryonpoints,
    Material=fem_part.Materials)  # -> U1, U2, U3, ElementStress, NodeStress, Diagonstics, FE_Mesh, Points, GlobalK

# ----
# Result preview
number_slider_5 = Slider(1, range=1..6)
meshpreview = MeshPreview(AnalysedFEMesh=part_fem_solver.FE_Mesh, Type=number_slider_5, DisplacementScaling=Slider(8229, range=0..10000))  # -> DeformedModel, DeformedMesh
mesh_edges_2 = MeshEdges(Mesh=meshpreview.DeformedMesh)  # -> NakedEdges, InteriorEdges, NonManifoldEdges

# ----
# Ferret
nodalresults = NodalResults(FEMesh=part_fem_solver.FE_Mesh)  # -> Points, U1, U2, U3, Mises, Xx, Yy, Zz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

# ----
# Nodal resuls
number_size = Slider(4, range=0..1000)
number_slider_6 = Slider(794, range=0..10000)
item_3 = ListItem(List=nodalresults.Xx, Index=number_slider_6, Wrap=True)
item_4 = ListItem(List=nodalresults.Points, Index=number_slider_6, Wrap=True)
points = PointList(Points=nodalresults.Points, Size=number_size)
result_value = Panel(item_3)
node = Point(item_4)

# ----
# Results sorted in ascending order
sort = SortList(Keys=nodalresults.Xx)  # -> Keys, ValuesA
panel_5 = Panel(sort.Keys)
