# Grasshopper definition CaseStudy4.gh (Grasshopper 1.0.7)
# plug-ins: SolidFEM, GH_to_FEniCSx, BullAnt, TetgenGH

_3d_scanned_column = Mesh(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)
number_of_cuts = Slider(142, range=0..1000)
stright_curve = Curve(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)
ggmeshtobrep = GgMeshToBrep(Mesh=_3d_scanned_column, Collapse=Toggle(True), Triangulate=Toggle(True), Tol=0.01)
perp_frames = PerpFrames(Curve=stright_curve, Count=number_of_cuts, Align=True)  # -> Frames, Parameters
mesh_plane = MeshPlane(Mesh=_3d_scanned_column, Plane=perp_frames.Frames)  # -> flatten(Curves)
area = Area(Geometry=mesh_plane)  # -> Area, graft(Centroid)
polyline = PolyLine(Vertices=flatten(area.Centroid), Closed=False)
end_points = EndPoints(Curve=polyline)  # -> Start, End

# ----
# Make solid brep to intersect:
x_width = Slider(178, range=0..1000)
y_width = Slider(178, range=0..1000)
division = Division(A=x_width, B=2)
division_2 = Division(A=y_width, B=2)
negative = Negative(Value=division)
negative_2 = Negative(Value=division_2)
construct_domain = ConstructDomain(DomainStart=division_2, DomainEnd=negative_2)
construct_domain_2 = ConstructDomain(DomainStart=division, DomainEnd=negative)
perp_frames_2 = PerpFrames(Curve=polyline, Count="18", Align=True)  # -> Frames, Parameters
rectangle = Rectangle(Plane=perp_frames_2.Frames, XSize=construct_domain_2, YSize=construct_domain, Radius=0)  # -> Rectangle, Length
loft = Loft(
    Curves=rectangle.Rectangle,
    Options={Adjust=False, Closed=False, LoftEnds=0, LoftSimp=0, LoftType=0, Rebuild=10, Refit=0.01})
cap_holes = CapHoles(Brep=loft)

# ----
# Perfect column with free mesh
unit_z = UnitZ(Factor=1)
distance = Distance(PointA=end_points.Start, PointB=end_points.End)
line_sdl = LineSDL(Start=end_points.Start, Direction=unit_z, Length=distance)
end_points_2 = EndPoints(Curve=line_sdl)  # -> Start, End
rectangle_2 = Rectangle(Plane=[end_points_2.Start, end_points_2.End], XSize=construct_domain_2, YSize=construct_domain, Radius=0)  # -> Rectangle, Length
loft_2 = Loft(
    Curves=rectangle_2.Rectangle,
    Options={Adjust=False, Closed=False, LoftEnds=0, LoftSimp=0, LoftType=0, Rebuild=10, Refit=0.01})
cap_holes_2 = CapHoles(Brep=loft_2)
mesh_brep = MeshBrep(
    Brep=cap_holes_2,
    Settings={GridMaxCount=0, GridMinCount=16, JaggedSeams=False, MaxEdgeLength=0, MinEdgeLength=0.0001, MinTolerance=0, Refine=True, RefineAngle=0, RelativeTolerance=0.65, SimplePlanes=True, Tolerance=0})

number_slider = Slider(1, range=1..40)  # disabled
number_slider_2 = Slider(28, range=1..40)  # disabled
number_slider_3 = Slider(1, range=1..20)  # disabled
panel = Panel("178")  # disabled
panel_2 = Panel("178")  # disabled
panel_3 = Panel("5122")  # disabled

# ----
# Optimize crosssection-size:
gjenomsnitt = CSharpScript(area=area.Area)  # -> aprox; inputs area: list of Double
# ---------- gjenomsnitt: C# ----------
    double sum = 0;

    foreach (double num in area) {
      sum += num;
    }

    aprox = sum/area.Count;
# ---------- end gjenomsnitt ----------
multiplication = Multiplication(A=division_2, B=2)
multiplication_2 = Multiplication(A=division, B=2)
multiplication_3 = Multiplication(A=multiplication, B=multiplication_2)
panel_4 = Panel(gjenomsnitt)
panel_5 = Panel(multiplication_3)
subtraction = Subtraction(A=gjenomsnitt, B=multiplication_3)
subtraction_2 = Subtraction(A=division, B=division_2)
absolute = Absolute(Value=subtraction)
absolute_2 = Absolute(Value=subtraction_2)
multiplication_4 = Multiplication(A=absolute_2, B="100")
galapagos = Galapagos(fitness=number, gene=[x_width, y_width])
addition = Addition(A=absolute, B=multiplication_4)
number = Number(addition)

# ----
# Perfect column with structured mesh
make_perfect_mesh = MakePerfectMesh(
    lenght=panel,
    nr_el_lenght=number_slider,
    width=panel_2,
    nr_el_width=number_slider_2,
    height=panel_3,
    nr_el_height=number_slider_3)  # disabled
simple_mesh = SimpleMesh(Brep=make_perfect_mesh)  # disabled
panel_6 = Panel("0")  # disabled
tetrahedralize = Tetrahedralize(Mesh=simple_mesh, Flags=panel_6, MinRatio=2)  # -> flatten(Mesh), Indices, Points; disabled
panel_7 = Panel(tetrahedralize.Mesh)  # disabled
list_length = ListLength(List=tetrahedralize.Mesh)  # disabled
nr_elements = Panel(list_length)  # disabled

mesh_edges = MeshEdges(Mesh=tetrahedralize.Mesh)  # -> NakedEdges, InteriorEdges, NonManifoldEdges; disabled

# ----
# Reproduce a brep of the 3D scanned column
solid_intersection = SolidIntersection(BrepsA=ggmeshtobrep, BrepsB=cap_holes)
cap_holes_3 = CapHoles(Brep=solid_intersection)
mesh_brep_2 = MeshBrep(
    Brep=cap_holes_3,
    Settings={GridMaxCount=0, GridMinCount=16, JaggedSeams=False, MaxEdgeLength=0, MinEdgeLength=0.0001, MinTolerance=0, Refine=True, RefineAngle=0, RelativeTolerance=0.65, SimplePlanes=True, Tolerance=0})

# ----
# Connect the geometry you want:
data_dam = DataDam(DataDataA=mesh_brep_2, BufferDelay=10000000, BufferMode=0)

# ----
# Making the tetrino-mesh
nr_of_divisions = Slider(800, range=0..5000)
quad_remesh_settings = QuadRemeshSettings(
    TargetCount=nr_of_divisions,
    AdaptiveSize=0,
    AdaptiveCount=Toggle(True),
    HardEdges=Toggle(True),
    SeamEdges=0,
    Symmetry=0,
    GuideCurves=0)
quad_remesh = QuadRemesh(Mesh=data_dam, Guides=polyline, Settings=quad_remesh_settings)
tetrahedralize_2 = Tetrahedralize(Mesh=quad_remesh, Flags="2", MinRatio=2)  # -> Mesh, Indices, Points
tetrahedralize_3 = Tetrahedralize(Mesh=quad_remesh, Flags="0", MinRatio=2)  # -> Mesh, Indices, Points
list_length_2 = ListLength(List=tetrahedralize_3.Mesh)
mesh_edges_2 = MeshEdges(Mesh=tetrahedralize_3.Mesh)  # -> NakedEdges, InteriorEdges, NonManifoldEdges
nr_of_elements = Panel(list_length_2)

# ----
# Picking load and BC points
# This component is made for
# FEniCSx but works well to
# collect the points you whant.
height_box = Slider(79, range=0..10000)
start_end_point_deformed_column = Point([end_points.Start, end_points.End])
start_end_point_perfect_column = Point([end_points_2.Start, end_points_2.End])
make_load_and_bc_brep = MakeLoadAndBCBrep(connect_start_and_end_point=start_end_point_deformed_column, x_width=division, y_width=division_2, height_box=height_box)  # -> domain, bc_brep_2, load_brep_2, domain_2
infolbc = InfoLBC(Point=tetrahedralize_2.Points, BC_brep=make_load_and_bc_brep.bc_brep_2, Load_brep=make_load_and_bc_brep.load_brep_2)  # -> Info, BCPoint, LoadPoint, LoadPoint2, LoadPoint3, LoadPoint4
point = Point(infolbc.BCPoint)
point_2 = Point(infolbc.LoadPoint)

data_dam_2 = DataDam(DataDataA=tetrahedralize_3.Mesh, BufferDelay=10000000, BufferMode=0)
mesh = Mesh(data_dam_2)

# ----
# Ferret
# Load
list_length_3 = ListLength(List=point_2)
division_3 = Division(A="-10000", B=list_length_3)
unit_z_2 = UnitZ(Factor=division_3)
fem_load = FEMLoad(MeshList=mesh, Type="1", Position=point_2, Vector=unit_z_2)  # -> Load, Points, ResultantLoadAndArea

# ----
# Material
number_slider_4 = Slider(30, range=0..100)
fem_material_orto = FEMMaterialOrto(
    YoungModulusE1=10000,
    YoungModulusE2=800,
    YoungModulusE3=400,
    ShearModulusG1=600,
    ShearModulusG2=600,
    ShearModulusG3=30,
    PossionRatioV12=0.5,
    PossionRatioV13=0.6,
    PossionRatioV23=0.6,
    YieldingStress=number_slider_4,
    MaterialWeight=Slider(0, range=0..1000))
fem_material = FEMMaterial(YoungModulus=210000, PossionRatio=0.3, YieldingStress=355, MaterialWeight=7850)

# ----
# Support
fem_boundaryonpoints = FEM_BoundaryOnPoints(Mesh=mesh, SupportPoints=point, Ty_2=True, Ty_3=True, Ty_4=True)

# ----
# Solver
panel_8 = Panel("2")
new_fem_solver = NEWFEMSolver(Mesh=mesh, ElementOrder=1, Loads=fem_load.Load, BoundaryConditions=fem_boundaryonpoints, Material=fem_material_orto)  # -> U1, U2, U3, ElementStress, NodeStress, Diagonstics, FE_Mesh, Points, GlobalK

# ----
# Pick the node you want:
# Result preview
size_on_numer = Slider(3, range=0..10)
sort_list = SortList(Keys=new_fem_solver.NodeStress)  # -> reverse(Keys), ValuesValuesA
sort_list_2 = SortList(Keys=new_fem_solver.U3)  # -> Keys, ValuesValuesA
point_list = PointList(Points=new_fem_solver.Points, Size=size_on_numer)
list_item = ListItem(List=new_fem_solver.Points, Index="1889", Wrap=True)
list_item_2 = ListItem(List=new_fem_solver.U3, Index="1889", Wrap=True)
list_item_3 = ListItem(List=new_fem_solver.NodeStress, Index="1889", Wrap=True)
displacement_middle = Panel(list_item_2)
stresses_middle = Panel(list_item_3)
set_preview_output = Slider(1, range=0..4)
scaling = Slider(0, range=0..100)
max_displacements = Panel(sort_list_2.Keys)
meshpreview = MeshPreview(AnalysedFEMesh=new_fem_solver.FE_Mesh, Type=set_preview_output, DisplacementScaling=scaling)  # -> DeformedModel, DeformedMesh
max_stresses = Panel(sort_list.Keys)

# ==== cluster MakeLoadAndBCBrep
x_width = ClusterInput()
y_width = ClusterInput()
x_width_2 = Number(x_width)
y_width_2 = Number(y_width)
addition = Addition(A=x_width_2, B=10)
addition_2 = Addition(A=y_width_2, B=10)
negative = Negative(Value=addition)
negative_2 = Negative(Value=addition_2)
connect_start_and_end_point = ClusterInput()
construct_domain = ConstructDomain(DomainStart=addition, DomainEnd=negative)
construct_domain_2 = ConstructDomain(DomainStart=addition_2, DomainEnd=negative_2)
connect_start_and_end_point_2 = Plane(connect_start_and_end_point)
domain = ClusterOutput(construct_domain)
domain_2 = ClusterOutput(construct_domain_2)
height_box = ClusterInput()
height_box_2 = Number(height_box)
negative_3 = Negative(Value=height_box_2)
rectangle = Rectangle(Plane=connect_start_and_end_point_2, XSize=construct_domain, YSize=construct_domain_2, Radius=0)  # -> Rectangle, Length
construct_domain_3 = ConstructDomain(DomainStart=height_box_2, DomainEnd=negative_3)
box_rectangle = BoxRectangle(Rectangle=rectangle.Rectangle, Height=construct_domain_3)
list_item = ListItem(List=box_rectangle, Index=0, Wrap=True)  # -> Item, Item1
load_brep = Brep(list_item.Item1)
bc_brep = Brep(list_item.Item)
bc_brep_2 = ClusterOutput(bc_brep)
load_brep_2 = ClusterOutput(load_brep)

# ==== cluster MakePerfectMesh
nr_el_width = ClusterInput()
nr_el_height = ClusterInput()
width = ClusterInput()
height = ClusterInput()
nr_el_lenght = ClusterInput()
lenght = ClusterInput()
nr_el_width_2 = Number(nr_el_width)
nr_el_height_2 = Number(nr_el_height)
width_2 = Number(width)
height_2 = Number(height)
nr_el_lenght_2 = Number(nr_el_lenght)
lenght_2 = Number(lenght)
series = Series(Start="0", Step="1", Count=nr_el_lenght_2)
series_2 = Series(Start="0", Step="1", Count=nr_el_height_2)
division = Division(A=lenght_2, B=nr_el_lenght_2)
series_3 = Series(Start="0", Step="1", Count=nr_el_width_2)
division_2 = Division(A=width_2, B=nr_el_width_2)
division_3 = Division(A=height_2, B=nr_el_height_2)
# Making elements
rectangle = Rectangle(Plane=PlaneXY(0, 0, 0), XSize=division, YSize=division_2, Radius=0)  # -> Rectangle, Length
box_rectangle = BoxRectangle(Rectangle=rectangle.Rectangle, Height=division_3)
multiplication = Multiplication(A=series, B=division)
multiplication_2 = Multiplication(A=series_3, B=division_2)
multiplication_3 = Multiplication(A=series_2, B=division_3)
unit_x = UnitX(Factor=multiplication)
unit_y = UnitY(Factor=multiplication_2)
unit_z = UnitZ(Factor=multiplication_3)
move = Move(Geometry=box_rectangle, Motion=unit_x)  # -> graft(Geometry), Transform
move_2 = Move(Geometry=move.Geometry, Motion=unit_y)  # -> graft(Geometry), Transform
move_3 = Move(Geometry=move_2.Geometry, Motion=unit_z)  # -> flatten(Geometry), Transform
geometry = ClusterOutput(move_3.Geometry)
hexahedron_elements = Brep(move_3.Geometry)
