# Grasshopper definition CaseStudy6.gh (Grasshopper 1.0.7)
# plug-ins: TetgenGH, GH_to_FEniCSx

# ----
# Make geometry:
number_slider = Slider(243, range=0..1000)
# By default, internal elements of a volume mesh are not displayed.
# To visualize them, use components from the "Utils" category.
number_slider_2 = Slider(-225, range=-500..0)
bottompositionoftheplate = Number(number_slider_2)
holesetoffsetfromedge = Number(Slider(200, range=0..1000))
numberofrows_holes = Number(Slider(4, range=0..10))
perpendicularplatesize = Number(Slider(120, range=0..1000))
holeoffsetfromedge = Number(Slider(56, range=0..100))
xy_plane = XYPlane(Origin=Point(0, 0, 0))
reduced_model = Number(Slider(150, range=0..1000))
dowel_lenght = Number(Slider(150, range=0..1000))
verticalplatesize = Number(Slider(154, range=0..1000))
platethickness = Number(Slider(6, range=0..10))
anglerotation = Number(Slider(-19, range=-20..20))
holediameter = Number(Slider(12, range=0..100))
platelength = Number(Slider(543, range=0..1000))
plateheight = Number(number_slider)
cluster = Cluster(
    bottompositionoftheplate=bottompositionoftheplate,
    verticalplatesize=verticalplatesize,
    perpendicularplatesize=perpendicularplatesize,
    numberofrows_holes=numberofrows_holes,
    holeoffsetfromedge=holeoffsetfromedge,
    holesetoffsetfromedge=holesetoffsetfromedge,
    holediameter=holediameter,
    platethickness=platethickness,
    anglerotation=anglerotation,
    platelength=platelength,
    plateheight=plateheight,
    plane=xy_plane,
    reduce_model=reduced_model,
    lenght_dowel=dowel_lenght)  # -> connection, dowels_2, result

custom_preview = CustomPreview(Geometry=cluster.connection, Material=ColourSwatch(SwatchColor=RGB(153, 153, 153)))

# ----
# Mesh geometry:
number_of_divisions = Slider(40000, range=0..60000)
quad_remesh_settings = QuadRemeshSettings(
    TargetCount=number_of_divisions,
    AdaptiveSize=Slider(60, range=0..100),
    AdaptiveCount=True,
    HardEdges=Toggle(True),
    SeamEdges=0,
    Symmetry=0,
    GuideCurves=0)
mesh_brep = MeshBrep(
    Brep=cluster.connection,
    Settings={GridMaxCount=0, GridMinCount=16, JaggedSeams=False, MaxEdgeLength=0, MinEdgeLength=0.0001, MinTolerance=0, Refine=True, RefineAngle=0, RelativeTolerance=0.65, SimplePlanes=True, Tolerance=0})
quad_remesh = QuadRemesh(Mesh=mesh_brep, Settings=quad_remesh_settings)
tetrahedralize = Tetrahedralize(Mesh=quad_remesh, Flags="2", MinRatio=2)  # -> Mesh, Indices, Points
tetrahedralize_2 = Tetrahedralize(Mesh=quad_remesh, Flags="0", MinRatio=2)  # -> Mesh, Indices, Points

# ----
# Definding loadingzones, loads and BC.
# Set load  [N/mm^2]:
brep = Brep(cluster.dowels_2)
brep_2 = Brep(cluster.dowels_2)
list_item = ListItem(List=brep, Index=0, Wrap=True)  # -> Item, Item1, Item2, Item3, Item4, Item5, Item6, Item7
list_item_2 = ListItem(List=brep_2, Index=0, Wrap=True)  # -> Item, Item1, Item2, Item3
list_item_3 = ListItem(List=brep_2, Index=0, Wrap=True)  # -> Item, Item1, Item2, Item3, Item4, Item5, Item6, Item7
load_paralell_to_rafters = Merge(Data1=list_item_2.Item, Data2=list_item_2.Item2)
load_perpenduculare_to_rafter = Merge(Data1=list_item_2.Item, Data2=list_item_2.Item1)
load_perpenduculare_to_rafter_2 = Merge(Data1=list_item_3.Item4, Data2=list_item_3.Item5)
load_paralell_to_rafters_2 = Merge(Data1=list_item_3.Item4, Data2=list_item_3.Item6)
merge = Merge(Data1=list_item.Item, Data2=list_item.Item1)
merge_2 = Merge(Data1=list_item.Item2, Data2=list_item.Item3)
merge_3 = Merge(Data1=list_item.Item6, Data2=list_item.Item7)
merge_4 = Merge(Data1=list_item.Item4, Data2=list_item.Item5)
adjust_placing_for_loading_2 = Slider(349, range=0..360)
adjust_placing_for_loading_1 = Slider(199, range=0..360)
tickness_of_loadingzone = Slider(0.4, range=0..10)
adjust_dowelsize = Slider(5.8, range=0..100)
definding_loadingzone = DefindingLoadingzone(angle=adjust_placing_for_loading_1, radius=adjust_dowelsize, B=tickness_of_loadingzone, geometry=merge)  # -> flatten(geometry_2)
definding_loadingzone_2 = DefindingLoadingzone(angle=adjust_placing_for_loading_1, radius=adjust_dowelsize, B=tickness_of_loadingzone, geometry=merge_2)  # -> flatten(geometry_2)
definding_loadingzone_3 = DefindingLoadingzone(angle=adjust_placing_for_loading_2, radius=adjust_dowelsize, B=tickness_of_loadingzone, geometry=merge_3)  # -> flatten(geometry_2)
definding_loadingzone_4 = DefindingLoadingzone(angle=adjust_placing_for_loading_2, radius=adjust_dowelsize, B=tickness_of_loadingzone, geometry=merge_4)  # -> flatten(geometry_2)
bc_brep = Brep(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)
infolbc = InfoLBC(
    Point=tetrahedralize.Points,
    BC_brep=bc_brep,
    Load_brep1=definding_loadingzone,
    Load_brep2=definding_loadingzone_2,
    Load_brep3=definding_loadingzone_3,
    Load_brep4=definding_loadingzone_4)  # -> Info, BCPoint, LoadPoint1, LoadPoint2, LoadPoint3, LoadPoint4
point = Point(infolbc.LoadPoint3)
point_2 = Point(infolbc.BCPoint)
point_3 = Point(infolbc.LoadPoint1)
point_4 = Point(infolbc.LoadPoint2)
point_5 = Point(infolbc.LoadPoint4)

# ----
# Load 3
find_direction_for_load_2 = FindDirectionForLoad2(geometry=load_paralell_to_rafters_2)  # -> result, result_2, result_3, line, vector, i
multiply_to_get_load = MultiplyToGetLoad(
    load_size="11.052",
    B=find_direction_for_load_2.result,
    B_2=find_direction_for_load_2.result_2,
    B_3=find_direction_for_load_2.result_3)  # -> result, result_2, result_3
vector_display = VectorDisplay(Anchor=find_direction_for_load_2.i, Vector=find_direction_for_load_2.vector)
negative = Negative(Value=multiply_to_get_load.result)
negative_2 = Negative(Value=multiply_to_get_load.result_2)
negative_3 = Negative(Value=multiply_to_get_load.result_3)
vector_xyz = VectorXYZ(XComponent=negative, YComponent=negative_2, ZComponent=negative_3)  # -> Vector, Length
vector_display_2 = VectorDisplay(Anchor=find_direction_for_load_2.i, Vector=vector_xyz.Vector)

# ----
# Load 4
find_direction_for_load_2_2 = FindDirectionForLoad2(geometry=load_paralell_to_rafters_2)  # -> result, result_2, result_3, line, vector, i
vector_display_3 = VectorDisplay(Anchor=find_direction_for_load_2_2.i, Vector=find_direction_for_load_2_2.vector)
multiply_to_get_load_2 = MultiplyToGetLoad(
    load_size="11.052",
    B=find_direction_for_load_2_2.result,
    B_2=find_direction_for_load_2_2.result_2,
    B_3=find_direction_for_load_2_2.result_3)  # -> result, result_2, result_3
negative_4 = Negative(Value=multiply_to_get_load_2.result)
negative_5 = Negative(Value=multiply_to_get_load_2.result_2)
negative_6 = Negative(Value=multiply_to_get_load_2.result_3)
vector_xyz_2 = VectorXYZ(XComponent=negative_4, YComponent=negative_5, ZComponent=negative_6)  # -> Vector, Length
vector_display_4 = VectorDisplay(Anchor=find_direction_for_load_2.i, Vector=vector_xyz_2.Vector)

# ----
# Load 2
find_direction_for_load_1 = FindDirectionForLoad2(geometry=load_paralell_to_rafters)  # -> result, result_2, result_3, line, vector, i
vector_display_5 = VectorDisplay(Anchor=find_direction_for_load_1.i, Vector=find_direction_for_load_1.vector)
multiply_to_get_load_3 = MultiplyToGetLoad(
    load_size="11.052",
    B=find_direction_for_load_1.result,
    B_2=find_direction_for_load_1.result_2,
    B_3=find_direction_for_load_1.result_3)  # -> result, result_2, result_3

# ----
# Load 1
find_direction_for_load_1_2 = FindDirectionForLoad2(geometry=load_paralell_to_rafters)  # -> result, result_2, result_3, line, vector, i
vector_display_6 = VectorDisplay(Anchor=find_direction_for_load_1_2.i, Vector=find_direction_for_load_1_2.vector)
multiply_to_get_load_4 = MultiplyToGetLoad(
    load_size="11.052",
    B=find_direction_for_load_1_2.result,
    B_2=find_direction_for_load_1_2.result_2,
    B_3=find_direction_for_load_1_2.result_3)  # -> result, result_2, result_3

loads = Loads(
    XDirection1=multiply_to_get_load_4.result,
    YDirection1=multiply_to_get_load_4.result_2,
    ZDirection1=multiply_to_get_load_4.result_3,
    XDirection2=multiply_to_get_load_3.result,
    YDirection2=multiply_to_get_load_3.result_2,
    ZDirection2=multiply_to_get_load_3.result_3,
    XDirection3=multiply_to_get_load.result,
    YDirection3=multiply_to_get_load.result_2,
    ZDirection3=multiply_to_get_load.result_3,
    XDirection4=multiply_to_get_load_2.result,
    YDirection4=multiply_to_get_load_2.result_2,
    ZDirection4=multiply_to_get_load_2.result_3)
panel = Panel(loads)

# ----
# Solver and results
collectdata = CollectData(Connectivity=tetrahedralize.Indices, Points=tetrahedralize.Points, Info=infolbc.Info, LoadInfo=loads)  # -> Bool, Time; disabled
fenicsxsolver = FEniCSxSolver(Bool=collectdata.Bool)  # -> Bool, Output
display_information_about_solver = Panel(fenicsxsolver.Output)
deformation_scaling = Slider(0, range=0..100000)
results = Results(Bool=fenicsxsolver.Bool, Points=tetrahedralize.Points, Scaliling=deformation_scaling)  # -> DisplacementU, DisplacementV, DisplacementW, MisesStress, DeformedPoints, Time

# ----
# Display deformation and collor pattern:
vector_xyz_3 = VectorXYZ(XComponent=results.DisplacementU, YComponent=results.DisplacementV, ZComponent=results.DisplacementW)  # -> Vector, Length
vector_length = VectorLength(Vector=vector_xyz_3.Vector)
displacement = Number(vector_length)
stress = Number(results.MisesStress)
bounds = Bounds(Numbers=displacement)
topologyconverter = TopologyConverter(Connectivity=tetrahedralize.Indices)
remap_numbers = RemapNumbers(Value=displacement, Source=bounds, Target=Domain(0, 1))  # -> Mapped, Clipped
gradient = Gradient(
    LowerLimit=0,
    UpperLimit=1,
    Parameter=remap_numbers.Mapped,
    stops=[0: RGB(0, 0, 255), 0.261: RGB(0, 255, 0), 0.586: RGB(255, 255, 0), 1: RGB(255, 0, 0)])
construct_mesh = ConstructMesh(Vertices=results.DeformedPoints, Faces=topologyconverter, Colours=gradient)
mesh_edges = MeshEdges(Mesh=construct_mesh)  # -> NakedEdges, InteriorEdges, NonManifoldEdges

# ----
# Results
list_length = ListLength(List=tetrahedralize_2.Mesh)
sort_list = SortList(Keys=results.DisplacementU)  # -> Keys, ValuesValuesA
sort_list_2 = SortList(Keys=results.DisplacementV)  # -> Keys, ValuesValuesA
sort_list_3 = SortList(Keys=results.MisesStress)  # -> reverse(Keys), ValuesValuesA
sort_list_4 = SortList(Keys=results.DisplacementW)  # -> reverse(Keys), ValuesValuesA
max_displacement_u = Panel(sort_list.Keys)
max_displacement_v = Panel(sort_list_2.Keys)
max_displacement_w = Panel(sort_list_4.Keys)
mises_stress = Panel(sort_list_3.Keys)
list_item_4 = ListItem(List=tetrahedralize.Points, Index="439", Wrap=True)
list_item_5 = ListItem(List=results.DisplacementW, Index="439", Wrap=True)
list_item_6 = ListItem(List=results.MisesStress, Index="439", Wrap=True)
displacement_node_middle = Panel(list_item_5)
mises_stress_node_middle = Panel(list_item_6)
nr_of_elements = Panel(list_length)
sphere = Sphere(Base=list_item_4, Radius=Slider(10, range=0..20))

# ==== cluster FindDirectionForLoad2
geometry = ClusterInput()
area = Area(Geometry=geometry)  # -> Area, Centroid
list_item = ListItem(List=area.Centroid, Index=0, Wrap=True)  # -> Item, Item1
vector_2pt = Vector2Pt(PointA=list_item.Item, PointB=list_item.Item1, Unitize=False)  # -> Vector, Length
line_sdl = LineSDL(Start=list_item.Item, Direction=vector_2pt.Vector, Length=vector_2pt.Length)
deconstruct_vector = DeconstructVector(Vector=vector_2pt.Vector)  # -> XComponent, YComponent, ZComponent
line = ClusterOutput(line_sdl)
vector = ClusterOutput(vector_2pt.Vector)
i = ClusterOutput(list_item.Item)
absolute = Absolute(Value=deconstruct_vector.XComponent)
absolute_2 = Absolute(Value=deconstruct_vector.YComponent)
absolute_3 = Absolute(Value=deconstruct_vector.ZComponent)
addition = Addition(A=absolute, B=absolute_2, C=absolute_3)
division = Division(A=deconstruct_vector.XComponent, B=addition)
division_2 = Division(A=deconstruct_vector.YComponent, B=addition)
division_3 = Division(A=deconstruct_vector.ZComponent, B=addition)
result = ClusterOutput(division)
result_2 = ClusterOutput(division_2)
result_3 = ClusterOutput(division_3)

# ==== cluster MultiplyToGetLoad
load_size = ClusterInput()
load_size_2 = Number(load_size)
B = ClusterInput()
B_2 = ClusterInput()
B_3 = ClusterInput()
multiplication = Multiplication(A=load_size_2, B=B)
multiplication_2 = Multiplication(A=load_size_2, B=B_2)
multiplication_3 = Multiplication(A=load_size_2, B=B_3)
result = ClusterOutput(multiplication)
result_2 = ClusterOutput(multiplication_2)
result_3 = ClusterOutput(multiplication_3)

# ==== cluster DefindingLoadingzone
geometry = ClusterInput()
deconstruct_brep = DeconstructBrep(Brep=geometry)  # -> Faces, Edges, Vertices
area = Area(Geometry=geometry)  # -> Area, Centroid
list_item = ListItem(List=deconstruct_brep.Edges, Index=0, Wrap=True)  # -> Item, Item1
length = Length(Curve=list_item.Item)
list_item_2 = ListItem(List=flatten(length), Index=0, Wrap=True)
division = Division(A=list_item_2, B=2)
unit_y = UnitY(Factor=division)
negative = Negative(Value=unit_y)
radius = ClusterInput()
move = Move(Geometry=area.Centroid, Motion=unit_y)  # -> Geometry, Transform
move_2 = Move(Geometry=area.Centroid, Motion=negative)  # -> Geometry, Transform
B = ClusterInput()
addition = Addition(A=radius, B=B)
line = Line(StartPoint=move.Geometry, EndPoint=move_2.Geometry)
panel = Panel(line)
perp_frames = PerpFrames(Curve=line, Count="1", Align=True)  # -> Frames, Parameters
arc = Arc(Plane=perp_frames.Frames, Radius=radius, Angle=Domain(0, 3.141592654))  # -> Arc, Length
arc_2 = Arc(Plane=perp_frames.Frames, Radius=addition, Angle=Domain(0, 3.141592654))  # -> Arc, Length
end_points = EndPoints(Curve=arc.Arc)  # -> Start, End
end_points_2 = EndPoints(Curve=arc_2.Arc)  # -> Start, End
list_item_3 = ListItem(List=arc_2.Arc, Index=0, Wrap=True)
list_item_4 = ListItem(List=arc.Arc, Index=0, Wrap=True)
list_item_5 = ListItem(List=arc_2.Arc, Index="1", Wrap=True)
list_item_6 = ListItem(List=arc.Arc, Index="1", Wrap=True)
line_2 = Line(StartPoint=end_points_2.Start, EndPoint=end_points.Start)
line_3 = Line(StartPoint=end_points_2.End, EndPoint=end_points.End)
join_curves = JoinCurves(Curves=[line_3, arc.Arc, line_2, arc_2.Arc], Preserve=False)
negative_2 = Negative(Value=list_item_2)
list_item_7 = ListItem(List=arc_2.Arc, Index=0, Wrap=True)
list_item_8 = ListItem(List=arc.Arc, Index=0, Wrap=True)
unit_y_2 = UnitY(Factor=negative_2)
curve = Curve(list_item_3)
curve_2 = Curve(list_item_5)
loft = Loft(
    Curves=[list_item_3, list_item_5],
    Options={Adjust=True, Closed=False, LoftEnds=0, LoftSimp=0, LoftType=0, Rebuild=10, Refit=0.01})
loft_2 = Loft(
    Curves=[list_item_4, list_item_6],
    Options={Adjust=False, Closed=False, LoftEnds=0, LoftSimp=0, LoftType=0, Rebuild=10, Refit=0.01})
move_3 = Move(Geometry=list_item_7, Motion=unit_y_2)  # -> Geometry, Transform
move_4 = Move(Geometry=list_item_8, Motion=unit_y_2)  # -> Geometry, Transform
loft_3 = Loft(
    Curves=[list_item_7, move_3.Geometry],
    Options={Adjust=False, Closed=False, LoftEnds=0, LoftSimp=0, LoftType=0, Rebuild=10, Refit=0.01})
loft_4 = Loft(
    Curves=[list_item_8, move_4.Geometry],
    Options={Adjust=False, Closed=False, LoftEnds=0, LoftSimp=0, LoftType=0, Rebuild=10, Refit=0.01})
loft_5 = Loft(Curves=[loft, loft_2], Options={Adjust=False, Closed=False, LoftEnds=0, LoftSimp=0, LoftType=0, Rebuild=10, Refit=0.01})
loft_6 = Loft(
    Curves=[loft_3, loft_4],
    Options={Adjust=False, Closed=False, LoftEnds=0, LoftSimp=0, LoftType=0, Rebuild=10, Refit=0.01})
deconstruct_brep_2 = DeconstructBrep(Brep=loft_5)  # -> reparameterize(Faces), Edges, Vertices
panel_2 = Panel("""0
2""")
list_item_9 = ListItem(List=deconstruct_brep_2.Faces, Index=panel_2, Wrap=True)
list_item_10 = ListItem(List=list_item_9, Index=Slider(0, range=0..10), Wrap=True)
deconstruct_brep_3 = DeconstructBrep(Brep=loft_6)  # -> simplify(Faces), Edges, Vertices
loft_7 = Loft(Curves=list_item_9, Options={Adjust=True, Closed=False, LoftEnds=0, LoftSimp=0, LoftType=3, Rebuild=10, Refit=0.01})
list_item_11 = ListItem(List=list_item_9, Index=0, Wrap=True)
panel_3 = Panel(list_item_9)
surface = Surface(deconstruct_brep_3.Faces)
deconstruct_brep_4 = DeconstructBrep(Brep=surface)  # -> Faces, Edges, Vertices
cap_holes = CapHoles(Brep=loft_7)  # -> simplify(Brep)
trim_tree = TrimTree(Tree=deconstruct_brep_4.Faces, Depth=1)
list_item_12 = ListItem(List=trim_tree, Index="2", Wrap=True)
area_2 = Area(Geometry=list_item_12)  # -> Area, Centroid
xz_plane = XZPlane(Origin=Point(0, 0, 0))
point = Point(simplify(graft(area.Centroid)))
list_item_13 = ListItem(List=trim_tree, Index="0", Wrap=True)
area_3 = Area(Geometry=list_item_13)  # -> Area, Centroid
vector_2pt = Vector2Pt(PointA=area_3.Centroid, PointB=area_2.Centroid, Unitize=False)  # -> Vector, Length
plane_origin = PlaneOrigin(Base=xz_plane, Origin=point)  # -> graft(Plane)
angle = ClusterInput()
extrude = Extrude(Base=list_item_13, Direction=vector_2pt.Vector)  # -> simplify(Extrusion)
brep = Brep(extrude)
rotate = Rotate(Geometry=graft(brep), Angle=degrees(angle), Plane=plane_origin)  # -> flatten(Geometry), Transform
unit_z = UnitZ(Factor=1)  # disabled
panel_4 = Panel("90")  # disabled
geometry_2 = ClusterOutput(rotate.Geometry)
rotate_3d = Rotate3D(Geometry=rotate.Geometry, Angle=degrees(panel_4), Center=area.Centroid, Axis=unit_z)  # -> Geometry, Transform; disabled

# ==== cluster Cluster
lenght_dowel = ClusterInput()
reduce_model = ClusterInput()
bottompositionoftheplate = ClusterInput()
holesetoffsetfromedge = ClusterInput()
holeoffsetfromedge = ClusterInput()
verticalplatesize = ClusterInput()
numberofrows_holes = ClusterInput()
perpendicularplatesize = ClusterInput()
plane = ClusterInput()
platethickness = ClusterInput()
anglerotation = ClusterInput()
holediameter = ClusterInput()
platelength = ClusterInput()
plateheight = ClusterInput()
bottompositionoftheplate_2 = Number(bottompositionoftheplate)
holesetoffsetfromedge_2 = Number(holesetoffsetfromedge)
lenght_dowel_2 = Number(lenght_dowel)
reduce_model_2 = Number(reduce_model)
verticalplatesize_2 = Number(verticalplatesize)
numberofrows_holes_2 = Number(numberofrows_holes)
perpendicularplatesize_2 = Number(perpendicularplatesize)
plane_2 = Plane(plane)
platethickness_2 = Number(platethickness)
anglerotation_2 = Number(anglerotation)
holediameter_2 = Number(holediameter)
holeoffsetfromedge_2 = Number(holeoffsetfromedge)
platelength_2 = Number(platelength)
plateheight_2 = Number(plateheight)
unit_x = UnitX(Factor=1)
unit_y = UnitY(Factor=1)
line_sdl = LineSDL(Start=plane_2, Direction=unit_y, Length="1000")
line_sdl_2 = LineSDL(Start=plane_2, Direction=unit_x, Length=platelength_2)
unit_y_2 = UnitY(Factor=bottompositionoftheplate_2)
unit_x_2 = UnitX(Factor=1)
division = Division(A=plateheight_2, B=2)
offset_curve = OffsetCurve(Curve=line_sdl_2, Distance=division, Plane=plane_2, Corners=1)
negative = Negative(Value=division)
offset_curve_2 = OffsetCurve(Curve=line_sdl_2, Distance=negative, Plane=plane_2, Corners=1)
merge = Merge(Data1=offset_curve_2, Data2=offset_curve)
rotate = Rotate(Geometry=merge, Angle=degrees(anglerotation_2), Plane=plane_2)  # -> Geometry, Transform
list_item = ListItem(List=rotate.Geometry, Index=0, Wrap=True)  # -> Item, Item1
line = Line(line_sdl)
division_2 = Division(A=verticalplatesize_2, B=2)
negative_2 = Negative(Value=division_2)
line_line = LineLine(Line1=line_sdl, Line2=list_item.Item1)  # -> ParamA, ParamB, PointA, PointB
line_line_2 = LineLine(Line1=line_sdl, Line2=list_item.Item)  # -> ParamA, ParamB, PointA, PointB
end_points = EndPoints(Curve=list_item.Item)  # -> Start, End
end_points_2 = EndPoints(Curve=list_item.Item1)  # -> Start, End
move = Move(Geometry=plane_2, Motion=unit_y_2)  # -> Geometry, Transform
line_sdl_3 = LineSDL(Start=move.Geometry, Direction=unit_x_2, Length="1000")
offset_curve_3 = OffsetCurve(Curve=line, Distance=division_2, Plane=plane_2, Corners=1)
offset_curve_4 = OffsetCurve(Curve=line, Distance=negative_2, Plane=plane_2, Corners=1)
line_2 = Line(StartPoint=end_points.Start, EndPoint=end_points_2.Start)
line_3 = Line(line_sdl_3)
line_4 = Line(StartPoint=end_points.End, EndPoint=end_points_2.End)
line_5 = Line(line_sdl)
line_6 = Line(StartPoint=line_line.PointA, EndPoint=end_points_2.End)
line_7 = Line(StartPoint=line_line_2.PointA, EndPoint=end_points.End)
series = Series(Start=holesetoffsetfromedge_2, Step=holesetoffsetfromedge_2, Count=numberofrows_holes_2)
division_3 = Division(A=platethickness_2, B=2)
line_line_3 = LineLine(Line1=offset_curve_4, Line2=line_sdl_3)  # -> ParamA, ParamB, PointA, PointB
line_line_4 = LineLine(Line1=offset_curve_3, Line2=line_sdl_3)  # -> ParamA, ParamB, PointA, PointB
negative_3 = Negative(Value=division_3)
negative_4 = Negative(Value=holeoffsetfromedge_2)
end_points_3 = EndPoints(Curve=line_7)  # -> Start, End
end_points_4 = EndPoints(Curve=line_6)  # -> Start, End
offset_curve_5 = OffsetCurve(Curve=line_5, Distance=division_3, Corners=1)
offset_curve_6 = OffsetCurve(Curve=line_5, Distance=negative_3, Corners=1)
offset_curve_7 = OffsetCurve(Curve=line_4, Distance=series, Corners=1)  # -> flatten(Curve)
point = Point(line_line_4.PointA)
offset_curve_8 = OffsetCurve(Curve=list_item.Item, Distance=holeoffsetfromedge_2, Corners=1)
offset_curve_9 = OffsetCurve(Curve=list_item.Item1, Distance=negative_4, Corners=1)
point_2 = Point(line_line_3.PointA)
number = Number(platethickness_2)
line_8 = Line(StartPoint=end_points_3.End, EndPoint=end_points_4.End)
line_line_5 = LineLine(Line1=offset_curve_5, Line2=line_3)  # -> ParamA, ParamB, PointA, PointB
line_9 = Line(StartPoint=point, EndPoint=point_2)
line_line_6 = LineLine(Line1=offset_curve_6, Line2=line_3)  # -> ParamA, ParamB, PointA, PointB
line_10 = Line(StartPoint=end_points_3.Start, EndPoint=end_points_4.Start)
line_11 = Line(StartPoint=move.Geometry, EndPoint=point)
negative_5 = Negative(Value=number)
line_line_7 = LineLine(Line1=offset_curve_3, Line2=line_sdl_3)  # -> ParamA, ParamB, PointA, PointB
multiple_curves = MultipleCurves(Curves=flatten([offset_curve_7, offset_curve_8, offset_curve_9]))  # -> flatten(Points), IndexA, IndexB, ParamA, ParamB
offset_curve_10 = OffsetCurve(Curve=line_9, Distance=negative_5, Plane=plane_2, Corners=1)
division_4 = Division(A=holediameter_2, B=2)
merge_2 = Merge(Data2=line_8, Data3=line_7, Data4=line_6)
circle = Circle(Plane=multiple_curves.Points, Radius=division_4)
unit_y_3 = UnitY(Factor="20")
unit_z = UnitZ(Factor=perpendicularplatesize_2)
loft = Loft(
    Curves=flatten([line_9, offset_curve_10]),
    Options={Adjust=False, Closed=False, LoftEnds=0, LoftSimp=0, LoftType=0, Rebuild=10, Refit=0.01})
division_5 = Division(A=perpendicularplatesize_2, B=2)
negative_6 = Negative(Value=division_5)
curve = Curve(merge_2)
line_12 = Line(curve)
list_item_2 = ListItem(List=line_12, Index=0, Wrap=True)  # -> Item, Item1, Item2
line_13 = Line(list_item_2.Item1)
line_line_8 = LineLine(Line1=offset_curve_5, Line2=line_13)  # -> ParamA, ParamB, PointA, PointB
line_line_9 = LineLine(Line1=offset_curve_6, Line2=line_13)  # -> ParamA, ParamB, PointA, PointB
line_line_10 = LineLine(Line1=offset_curve_3, Line2=list_item_2.Item2)  # -> ParamA, ParamB, PointA, PointB
move_2 = Move(Geometry=line_line_8.PointA, Motion=unit_y_3)  # -> Geometry, Transform
line_14 = Line(StartPoint=line_line_10.PointA, EndPoint=point)
end_points_5 = EndPoints(Curve=list_item_2.Item2)  # -> Start, End
curve_2 = Curve(circle)
extrude = Extrude(Base=loft, Direction=unit_z)
unit_z_2 = UnitZ(Factor=negative_6)
line_15 = Line(StartPoint=end_points_5.End, EndPoint=line_line_10.PointA)
line_16 = Line(flatten([list_item_2.Item, list_item_2.Item1, line_15, line_14, line_11]))
line_17 = Line(StartPoint=move_2.Geometry, EndPoint=line_line_5.PointA)
line_18 = Line(StartPoint=end_points_5.Start, EndPoint=line_line_10.PointA)
move_3 = Move(Geometry=extrude, Motion=unit_z_2)  # -> Geometry, Transform
yz_plane = YZPlane(Origin=Point(0, 0, 0))
offset_curve_11 = OffsetCurve(Curve=line_17, Distance=platethickness_2, Corners=1)
mirror = Mirror(Geometry=line_18, Plane=yz_plane)  # -> Geometry, Transform
mirror_2 = Mirror(Geometry=line_16, Plane=yz_plane)  # -> Geometry, Transform
mirror_3 = Mirror(Geometry=curve_2, Plane=yz_plane)  # -> Geometry, Transform
loft_2 = Loft(
    Curves=flatten([offset_curve_11, line_17]),
    Options={Adjust=False, Closed=False, LoftEnds=0, LoftSimp=0, LoftType=0, Rebuild=10, Refit=0.01})
join_curves = JoinCurves(Curves=flatten([mirror.Geometry, line_18]), Preserve=False)
negative_7 = Negative(Value=platethickness_2)
join_curves_2 = JoinCurves(Curves=[line_16, mirror_2.Geometry], Preserve=False)
boundary_surfaces = BoundarySurfaces(Edges=flatten(join_curves_2))
unit_y_4 = UnitY(Factor=negative_7)
boundary_surfaces_2 = BoundarySurfaces(Edges=flatten([join_curves_2, mirror_3.Geometry, curve_2]))
move_4 = Move(Geometry=join_curves, Motion=unit_y_4)  # -> Geometry, Transform
end_points_6 = EndPoints(Curve=move_4.Geometry)  # -> Start, End
end_points_7 = EndPoints(Curve=join_curves)  # -> Start, End
unit_z_3 = UnitZ(Factor=platethickness_2)
division_6 = Division(A=platethickness_2, B=2)
unit_z_4 = UnitZ(Factor=perpendicularplatesize_2)
extrude_2 = Extrude(Base=boundary_surfaces, Direction=unit_z_3)
division_7 = Division(A=perpendicularplatesize_2, B=2)
unit_z_5 = UnitZ(Factor=division_6)
negative_8 = Negative(Value=division_7)
line_19 = Line(StartPoint=end_points_6.End, EndPoint=end_points_7.End)
line_20 = Line(StartPoint=end_points_6.Start, EndPoint=end_points_7.Start)
extrude_3 = Extrude(Base=boundary_surfaces_2, Direction=unit_z_3)
extrude_4 = Extrude(Base=loft_2, Direction=unit_z_4)
unit_z_6 = UnitZ(Factor=negative_8)
move_5 = Move(Geometry=extrude_3, Motion=unit_z_5)  # -> Geometry, Transform
merge_3 = Merge(Data1=line_20, Data2=line_19, Data3=move_4.Geometry, Data4=join_curves)  # -> flatten(Result)
move_6 = Move(Geometry=extrude_4, Motion=unit_z_6)  # -> Geometry, Transform
boundary_surfaces_3 = BoundarySurfaces(Edges=merge_3)
solid_difference = SolidDifference(BrepsA=extrude_2, BrepsB=extrude_3)
volume = Volume(Geometry=solid_difference)  # -> Volume, Centroid
unit_z_7 = UnitZ(Factor=perpendicularplatesize_2)
division_8 = Division(A=perpendicularplatesize_2, B=2)
division_9 = Division(A=holediameter_2, B=2)
negative_9 = Negative(Value=division_8)
extrude_5 = Extrude(Base=boundary_surfaces_3, Direction=unit_z_7)
brep = Brep(move_6.Geometry)
unit_z_8 = UnitZ(Factor=negative_9)
negative_10 = Negative(Value=lenght_dowel_2)
circle_2 = Circle(Plane=volume.Centroid, Radius=division_9)
move_7 = Move(Geometry=extrude_5, Motion=unit_z_8)  # -> Geometry, Transform
lenght_dowel_3 = Number(negative_10)
unit_z_9 = UnitZ(Factor=lenght_dowel_3)
division_10 = Division(A=lenght_dowel_2, B=2)
extrude_6 = Extrude(Base=circle_2, Direction=unit_z_9)
unit_z_10 = UnitZ(Factor=division_10)
brep_2 = Brep(move_5.Geometry)
move_8 = Move(Geometry=extrude_6, Motion=unit_z_10)  # -> Geometry, Transform
brep_3 = Brep(move_3.Geometry)
solid_union = SolidUnion(Breps=flatten([brep_3, brep_2, move_7.Geometry, brep]))
unit_x_3 = UnitX(Factor=1)
unit_x_4 = UnitX(Factor=1)
rotate_3d = Rotate3D(Geometry=solid_union, Angle=degrees(Slider(90, range=0..100)), Center=Point(0, 0, 0), Axis=unit_x_3)  # -> Geometry, Transform
rotate_3d_2 = Rotate3D(Geometry=move_8.Geometry, Angle=degrees(Slider(90, range=0..100)), Center=Point(0, 0, 0), Axis=unit_x_4)  # -> Geometry, Transform
deconstruct_brep = DeconstructBrep(Brep=rotate_3d.Geometry)  # -> Faces, Edges, Vertices
list_item_3 = ListItem(List=deconstruct_brep.Edges, Index=Slider(30, range=0..1000), Wrap=True)
list_item_4 = ListItem(List=deconstruct_brep.Edges, Index=Slider(312, range=0..1000), Wrap=True)
negative_11 = Negative(Value=platethickness_2)
negative_12 = Negative(Value=reduce_model_2)
negative_13 = Negative(Value=platethickness_2)
negative_14 = Negative(Value=reduce_model_2)
end_points_8 = EndPoints(Curve=list_item_3)  # -> Start, End
end_points_9 = EndPoints(Curve=list_item_4)  # -> Start, End
construct_domain = ConstructDomain(DomainStart=platethickness_2, DomainEnd=negative_11)
offset_curve_12 = OffsetCurve(Curve=list_item_3, Distance=reduce_model_2, Corners=1)
construct_domain_2 = ConstructDomain(DomainStart=platethickness_2, DomainEnd=negative_13)
offset_curve_13 = OffsetCurve(Curve=list_item_4, Distance=reduce_model_2, Corners=1)
end_points_10 = EndPoints(Curve=offset_curve_12)  # -> Start, End
end_points_11 = EndPoints(Curve=offset_curve_13)  # -> Start, End
unit_y_5 = UnitY(Factor=construct_domain)
unit_y_6 = UnitY(Factor=construct_domain_2)
_4point_surface = _4PointSurface(CornerA=end_points_8.Start, CornerB=end_points_8.End, CornerC=end_points_10.End, CornerD=end_points_10.Start)
_4point_surface_2 = _4PointSurface(CornerA=end_points_9.Start, CornerB=end_points_9.End, CornerC=end_points_11.End, CornerD=end_points_11.Start)
extrude_7 = Extrude(Base=_4point_surface_2, Direction=unit_y_6)
extrude_8 = Extrude(Base=_4point_surface, Direction=unit_y_5)
trim_solid = TrimSolid(Shape=rotate_3d.Geometry, Cutters=[extrude_7, extrude_8])
cap_holes = CapHoles(Brep=trim_solid)  # -> flatten(Connection)
dowels = Brep(rotate_3d_2.Geometry)
cap_holes_2 = CapHoles(Brep=dowels)  # -> flatten(Dowels)
connection = ClusterOutput(cap_holes)
solid_union_2 = SolidUnion(Breps=[cap_holes_2, cap_holes])
dowels_2 = ClusterOutput(cap_holes_2)
result = ClusterOutput(solid_union_2)
