# Grasshopper definition PreFerret.gh (Grasshopper 1.0.7)
# plug-ins: VegardOgOlav

# ----
# Global box
number_slider = Slider(1000, range=0..10000)
rectangle = Rectangle(Plane=PlaneXY(0, 0, 0), XSize=number_slider, YSize=number_slider, Radius=0)  # -> Rectangle, Length
box_rectangle = BoxRectangle(Rectangle=rectangle.Rectangle, Height=number_slider)
box_corners = BoxCorners(Box=box_rectangle)  # -> CornerA, CornerB, CornerC, CornerD, CornerE, CornerF, CornerG, CornerH
merge = Merge(
    Data1=box_corners.CornerA,
    Data2=box_corners.CornerB,
    Data3=box_corners.CornerC,
    Data4=box_corners.CornerD,
    Data5=box_corners.CornerE,
    Data6=box_corners.CornerF,
    Data7=box_corners.CornerG,
    Data8=box_corners.CornerH)

# ----
# Make mesh
make_perfect_mesh = MakePerfectMesh(
    lenght="1000",
    nr_el_lenght=Slider(2, range=1..40),
    width="1000",
    nr_el_width=Slider(2, range=1..20),
    height="1000",
    nr_el_height=Slider(2, range=1..20))
simple_mesh = SimpleMesh(Brep=make_perfect_mesh)
mesh = Mesh(simple_mesh)

# ----
# Support
deconstruct_mesh = DeconstructMesh(Mesh=mesh)  # -> flatten(Vertices), Faces, Colours, Normals
cull_duplicates = CullDuplicates(Points=deconstruct_mesh.Vertices, Tolerance=0.1, CullMode=3)  # -> Points, Indices, Valence
c_script = CSharpScript(x=cull_duplicates.Points)  # -> supPts; inputs x: list of Point3d
# ---------- c_script: C# ----------
    List<Point3d> sups = new List<Point3d>();

    for(int i = 0; i < x.Count;i++)
    {
      if(x[i].X < 0.10)
        sups.Add(x[i]);
    }
    supPts = sups;
# ---------- end c_script ----------
clean_tree = CleanTree(RemoveNulls=True, RemoveInvalid=True, RemoveEmpty=False, Tree=c_script)

# ----
# Load
number_slider_2 = Slider(10000, range=0..10000)
panel = Panel("""5
6""")
negative = Negative(Value=number_slider_2)
item = ListItem(List=merge, Index=panel, Wrap=True)
unit_z = UnitZ(Factor=negative)

load_points = Point(item)

# ----
# Load display
panel_2 = Panel("500")
unit_z_2 = UnitZ(Factor=panel_2)
move = Move(Geometry=load_points, Motion=unit_z_2)  # -> Geometry, Transform
division = Division(A=unit_z, B=Slider(20, range=0..100))
vector_display = VectorDisplay(Anchor=move.Geometry, Vector=division)

support_points = Point(clean_tree)

# ----
# PreFerret
support = Support(Point=flatten(support_points))
load = Load(Point=flatten(load_points), Direction=unit_z)
element = Element(Mesh=flatten(mesh))
assembly = Assembly(Element=element, Support=support, Load=load)
solver = Solver(Assembly=assembly)  # -> Result, Result_2

# ----
# Max displacement
sort_list = SortList(Keys=solver.Result_2)  # -> Keys, ValuesValuesA
list_item = ListItem(List=sort_list.Keys, Index=0, Wrap=True)
panel_3 = Panel(list_item)

# ----
# Cordinates of nodes r
panel_4 = Panel(solver.Result)

# ----
# Displacement(xi,yi,zi):
panel_5 = Panel(solver.Result_2)

# ----
# Find the correct node we want to see the displacements of:
element_number = Slider(14, range=0..3000)
size = Slider(46, range=0..1000)
point = Point(solver.Result)
multiplication = Multiplication(A=element_number, B="3")
list_item_2 = ListItem(List=solver.Result, Index=element_number, Wrap=True)
point_list = PointList(Points=point, Size=size)
series = Series(Start=multiplication, Step=1, Count="3")
list_item_3 = ListItem(List=solver.Result_2, Index=series, Wrap=True)
_0_x_1_y_2_z = Panel(list_item_3)

# ==== cluster MakePerfectMesh
nr_el_width = ClusterInput()
nr_el_height = ClusterInput()
width = ClusterInput()
height = ClusterInput()
nr_el_lenght = ClusterInput()
lenght = ClusterInput()
nr_el_width_2 = Number(nr_el_width)
nr_el_height_2 = Number(nr_el_height)
width_2 = Number(width)
height_2 = Number(height)
nr_el_lenght_2 = Number(nr_el_lenght)
lenght_2 = Number(lenght)
series = Series(Start="0", Step="1", Count=nr_el_lenght_2)
series_2 = Series(Start="0", Step="1", Count=nr_el_height_2)
division = Division(A=lenght_2, B=nr_el_lenght_2)
series_3 = Series(Start="0", Step="1", Count=nr_el_width_2)
division_2 = Division(A=width_2, B=nr_el_width_2)
division_3 = Division(A=height_2, B=nr_el_height_2)
# Making elements
rectangle = Rectangle(Plane=PlaneXY(0, 0, 0), XSize=division, YSize=division_2, Radius=0)  # -> Rectangle, Length
box_rectangle = BoxRectangle(Rectangle=rectangle.Rectangle, Height=division_3)
multiplication = Multiplication(A=series, B=division)
multiplication_2 = Multiplication(A=series_3, B=division_2)
multiplication_3 = Multiplication(A=series_2, B=division_3)
unit_x = UnitX(Factor=multiplication)
unit_y = UnitY(Factor=multiplication_2)
unit_z = UnitZ(Factor=multiplication_3)
move = Move(Geometry=box_rectangle, Motion=unit_x)  # -> graft(Geometry), Transform
move_2 = Move(Geometry=move.Geometry, Motion=unit_y)  # -> graft(Geometry), Transform
move_3 = Move(Geometry=move_2.Geometry, Motion=unit_z)  # -> flatten(Geometry), Transform
geometry = ClusterOutput(move_3.Geometry)
hexahedron_elements = Brep(move_3.Geometry)
